# Grasshopper definition sectiondrawer.gh (Grasshopper 0.9.76)
# plug-ins: Python Interpreter

marksize = Slider(10100, range=0..10100)
undo = Button()
nextsection = Button()
startdraw = BooleanToggle(False)

# ---- group: 切断線
crv = Curve()

# ----
reset = Button()
flip = BooleanToggle(False)
curvepoint = PointOnCurve(crv, parameter=0.5)
sort_pt = SortPoints(Points=curvepoint)  # -> Points, Indices
item = ListItem(List=crv, Index=sort_pt.Indices, Wrap=True)
crv_2 = Curve(item)
lng = ListLength(List=crv_2)
file = ReadFile(File="D:\python\sectiondrawer\sectiondrawer\sectiondrawer.py", PerLineParse=False)
end = EndPoints(Curve=crv_2)  # -> Start, End
series = Series(Start=0, Step=1, Count=lng)
merge = Merge(Data1=graft(end.Start), Data2=graft(end.End))
int = Integer(series)
python = PythonScript(
    Code=file,
    Curve=crv_2,
    Reverse=flip,
    Directory="D:\\test\",
    Name="name",
    Reset=reset,
    Next=nextsection,
    Draw=startdraw,
    Redo=undo,
    Parameter=Slider(0.84, range=0..1),
    Mark=marksize)  # -> Out, Direction, Circle
panel = Panel(python.Out)
tag = TextTag3D(Location=merge, Text=graft(int), Size=Slider(1, range=0..10), Justification=7)
